# Grasshopper definition Gerald_01_Scaling_Circles.gh (Grasshopper 1.0.7)

# ---- group: Scaling Parameters
minimum_circle_scale_factor = Slider(0.21, range=0..1)
maximum_circle_scale_factor = Slider(0.99, range=0..2)

# ---- group: Initial Setup Parameters
cell_size = Slider(2, range=0..10)
cells_x_direction = Slider(14, range=0..20)
cells_y_direction = Slider(10, range=0..20)

# ----
random_number_seed = Slider(0, range=0..100)
cells_x_directions = GetInteger(cells_x_direction, AtLeast=1, AtMost=1, Maximum=2147483647, Minimum=-2147483648)
min_scale_factor = GetNumber(minimum_circle_scale_factor, AtLeast=0, AtMost=2147483647, Maximum=1.797693135e+308, Minimum=-1.797693135e+308)
max_scale_factor = GetNumber(maximum_circle_scale_factor, AtLeast=0, AtMost=2147483647, Maximum=1.797693135e+308, Minimum=-1.797693135e+308)
cells_y_direction_2 = GetInteger(cells_y_direction, AtLeast=1, AtMost=1, Maximum=2147483647, Minimum=-2147483648)
cell_size_2 = GetInteger(cell_size, AtLeast=1, AtMost=1, Maximum=2147483647, Minimum=-2147483648)
random_seed_number = GetNumber(random_number_seed, AtLeast=0, AtMost=2147483647, Maximum=1.797693135e+308, Minimum=-1.797693135e+308)
hexgrid = Hexagonal(Plane=PlaneXY(0, 0, 0), Size=cell_size_2, ExtentX=cells_x_directions, ExtentY=cells_y_direction_2)  # -> Cells, Points

# ---- group: Centerpoints of Circles
pt = Point(flatten(hexgrid.Points))

# ----
cir = Circle(Plane=pt, Radius=cell_size_2)
dom = ConstructDomain(DomainStart=min_scale_factor, DomainEnd=max_scale_factor)
lng = ListLength(List=cir)
random = Random(Range=dom, Number=lng, Seed=random_seed_number)
scale = Scale(Geometry=cir, Center=pt, Factor=random)  # -> Geometry, Transform
boundary = BoundarySurfaces(Edges=scale.Geometry)
preview = CustomPreview(Geometry=boundary, Material=ColourSwatch(SwatchColor=RGBA(0, 102, 255, 38)))
context_bake = ContextBake(Geometry=boundary)
geo = Geometry(boundary)
